# Grasshopper definition example0.gh (Grasshopper 0.9.76)
# plug-ins: MyComponentLib

series = Series(Start=0, Step=1, Count=10)
list = ValueList({"One": 1, "Two": 2, "Three": 2² - 1, "Four": Sqrt(16)}, selected="Three")
listab = RetriveListAB(List=series, Shift=list, Circular=Toggle(False))  # -> Previous, Next
panel = Panel(listab.Previous)
panel_2 = Panel(listab.Next)
