# Grasshopper definition example1.gh (Grasshopper 0.9.76)
# plug-ins: MyComponentLib

cir = Circle(Plane=PlaneXY(0, 0, 0), Radius=10)
list = ValueList({"One": 1, "Two": 2, "Three": 2² - 1, "Four": Sqrt(16)}, selected="Three")
divide = DivideCurve(Curve=cir, Count=10, Kinks=False)  # -> Points, Tangents, Parameters
listab = RetriveListAB(List=divide.Points, Shift=list, Circular=Toggle(True))  # -> Previous, Next
ln = Line(StartPoint=listab.Previous, EndPoint=listab.Next)
