# Grasshopper definition example2.gh (Grasshopper 0.9.76)
# plug-ins: MyComponentLib

crv = Curve([<curve referenced from the Rhino model> x8])
curvepoint = PointOnCurve(crv, parameter=0.5)
pdecon = Deconstruct(Point=curvepoint)  # -> XComponent, YComponent, ZComponent
sort = SortList(Keys=pdecon.ZComponent, ValuesA=crv)  # -> Keys, ValuesA
number_slider = Slider(37, range=0..101)
listab = RetriveListAB(List=sort.ValuesA, Shift=1, Circular=False)  # -> Previous, Next
toggle = BooleanToggle(True)
divide = DivideCurve(Curve=listab.Next, Count=number_slider, Kinks=False)  # -> Points, Tangents, Parameters
divide_2 = DivideCurve(Curve=listab.Previous, Count=number_slider, Kinks=False)  # -> Points, Tangents, Parameters
listab_2 = RetriveListAB(List=divide.Points, Shift=1, Circular=toggle)  # -> Previous, Next
listab_3 = RetriveListAB(List=divide_2.Points, Shift=1, Circular=toggle)  # -> Previous, Next
srf4pt = _4PointSurface(CornerA=listab_3.Previous, CornerB=listab_2.Previous, CornerC=listab_2.Next, CornerD=listab_3.Next)
